# Dynamo custom node (2) Color Scale Format Condition.dyf (Dynamo 2.0.1.5055)
# category: archilab_Bumblebee.Format
# This node will generate a two (2) color scheme that can be used to format a range of numbers in Excel.

MinValueType = Input(MinValueType: var[]..[])
MinValue = Input(MinValue: var = null)
MinColor = Input(MinColor: var[]..[])
MaxValueType = Input(MaxValueType: var[]..[])
MaxValue = Input(MaxValue: var = null)
MaxColor = Input(MaxColor: var[]..[])
python_script = Python(IN[0]=MinValueType, IN[1]=MinValue, IN[2]=MinColor, IN[3]=MaxValueType, IN[4]=MaxValue, IN[5]=MaxColor)
# ---------- python_script.python (44 lines) ----------
# Copyright(c) 2016, David Mans, Konrad Sobon
# @arch_laboratory, http://archi-lab.net, http://neoarchaic.net

import clr
import sys

pyt_path = r'C:\Program Files (x86)\IronPython 2.7\Lib'
sys.path.append(pyt_path)

import System
assemblies = System.AppDomain.CurrentDomain.GetAssemblies()
path1 = [a.Location for a in assemblies if 'bumblebee,' in a.FullName][0]
path2 = System.IO.Path.GetDirectoryName(path1).rsplit('\\',1)[0]
bb_path = '%s\\extra\\' %path2
sys.path.append(bb_path)
import bumblebee as bb

#The inputs to this node will be stored as a list in the IN variable.
dataEnteringNode = IN

minType = IN[0]
minValue = IN[1]
minColor = IN[2]
maxType = IN[3]
maxValue = IN[4]
maxColor = IN[5]

colorScale = bb.BB2ColorScaleFormatCondition()

if minType != None:
	colorScale.minType = minType
if minValue != None:
	colorScale.minValue = minValue
if minColor != None:
	colorScale.minColor = minColor
if maxType != None:
	colorScale.maxType = maxType
if maxValue != None:
	colorScale.maxValue = maxValue
if maxColor != None:
	colorScale.maxColor = maxColor

#Assign your output to the OUT variable
OUT = colorScale
# ----------------------------------------
FormatCondition = Output(python_script)
