# Dynamo custom node BB Data.dyf (Dynamo 2.0.1.5055)
# category: archilab_Bumblebee.Write
# This node is a building block for different modes of writing to Excel files. You can combines this node into a list to write to multiple sheets or use just one to write to a single sheet.

sheetName = Input(sheetName: var[]..[])
origin = Input(origin: var[]..[])
data = Input(data: var[]..[])  # Data in form of a list or nested list
python_script = Python(IN[0]=sheetName, IN[1]=origin, IN[2]=data)
# ---------- python_script.python (40 lines) ----------
# Copyright(c) 2016, David Mans, Konrad Sobon
# @arch_laboratory, http://archi-lab.net, http://neoarchaic.net

import clr
import sys

pyt_path = r'C:\Program Files (x86)\IronPython 2.7\Lib'
sys.path.append(pyt_path)

import System
assemblies = System.AppDomain.CurrentDomain.GetAssemblies()
path1 = [a.Location for a in assemblies if 'bumblebee,' in a.FullName][0]
path2 = System.IO.Path.GetDirectoryName(path1).rsplit('\\',1)[0]
bb_path = '%s\\extra\\' %path2
sys.path.append(bb_path)
import bumblebee as bb

#The inputs to this node will be stored as a list in the IN variable.
dataEnteringNode = IN

sheetName = IN[0]
origin = IN[1]
data = IN[2]

# Make BBData object if list or make multiple BBData objects if
# list depth == 3
if isinstance(sheetName, list):
	if isinstance(origin, list):
		dataObjectList = []
		for i, j, k in zip(sheetName, origin, data):
			dataObjectList.append(bb.MakeDataObject(i, j, k))
	else:
		dataObjectList = []
		for i, j in zip(sheetName, data):
			dataObjectList.append(bb.MakeDataObject(i,None,j))
else:
	dataObjectList = bb.MakeDataObject(sheetName, origin, data)

#Assign your output to the OUT variable
OUT = dataObjectList
# ----------------------------------------
BBData = Output(python_script)
