# Dynamo custom node BB Style.dyf (Dynamo 2.0.1.5055)
# category: archilab_Bumblebee.Styles
# This node is a building block for different modes of formatting an Excel file. You can combines this node into a list to apply formatting to multiple ranges or sheets at the same time.

SheetName = Input(SheetName: var = null)
CellRange = Input(CellRange: var[]..[])
GraphicStyle = Input(GraphicStyle: var[]..[])
python_script = Python(IN[0]=SheetName, IN[1]=CellRange, IN[2]=GraphicStyle)
# ---------- python_script.python (40 lines) ----------
# Copyright(c) 2016, David Mans, Konrad Sobon
# @arch_laboratory, http://archi-lab.net, http://neoarchaic.net

import clr
import sys

pyt_path = r'C:\Program Files (x86)\IronPython 2.7\Lib'
sys.path.append(pyt_path)

import System
assemblies = System.AppDomain.CurrentDomain.GetAssemblies()
path1 = [a.Location for a in assemblies if 'bumblebee,' in a.FullName][0]
path2 = System.IO.Path.GetDirectoryName(path1).rsplit('\\',1)[0]
bb_path = '%s\\extra\\' %path2
sys.path.append(bb_path)
import bumblebee as bb

#The inputs to this node will be stored as a list in the IN variable.
dataEnteringNode = IN

sheetName = IN[0]
cellRange = IN[1]
graphicStyle = IN[2]

# Make BBStyle object if list or make multiple BBStyle objects if
# list depth == 3
if isinstance(sheetName, list):
	if isinstance(cellRange, list):
		dataObjectList = []
		for i, j, k in zip(sheetName, cellRange, graphicStyle):
			dataObjectList.append(bb.MakeStyleObject(i, j, k))
	else:
		dataObjectList = []
		for i, j in zip(sheetName, graphicStyle):
			dataObjectList.append(bb.MakeStyleObject(i,None,j))
else:
	dataObjectList = bb.MakeStyleObject(sheetName, cellRange, graphicStyle)

#Assign your output to the OUT variable
OUT = dataObjectList
# ----------------------------------------
BB_Style = Output(python_script)
