# Dynamo custom node Border Style.dyf (Dynamo 2.0.1.5055)
# category: archilab_Bumblebee.Styles
# This node can be used to change default formatting of Excel cells using Format Excel of Conditionally Format Excel Nodes.

LineType = Input(LineType: var = null)
LineWeightType = Input(LineWeightType: var = null)
LineColor = Input(LineColor: var = null)
python_script = Python(IN[0]=LineType, IN[1]=LineWeightType, IN[2]=LineColor)
# ---------- python_script.python (35 lines) ----------
# Copyright(c) 2016, David Mans, Konrad Sobon
# @arch_laboratory, http://archi-lab.net, http://neoarchaic.net

import clr
import sys

pyt_path = r'C:\Program Files (x86)\IronPython 2.7\Lib'
sys.path.append(pyt_path)

import System
assemblies = System.AppDomain.CurrentDomain.GetAssemblies()
path1 = [a.Location for a in assemblies if 'bumblebee,' in a.FullName][0]
path2 = System.IO.Path.GetDirectoryName(path1).rsplit('\\',1)[0]
bb_path = '%s\\extra\\' %path2
sys.path.append(bb_path)
import bumblebee as bb

#The inputs to this node will be stored as a list in the IN variable.
dataEnteringNode = IN

lineType = IN[0]
weight = IN[1]
color = IN[2]

borderStyle = bb.BBBorderStyle()

if lineType != None:
	borderStyle.lineType = lineType
if weight != None:
	borderStyle.weight = weight
if color != None:
	borderStyle.color = color

#Assign your output to the OUT variable
OUT = borderStyle
# ----------------------------------------
OUT = Output(python_script)
