# Dynamo custom node Cell Index.dyf (Dynamo 2.0.1.5055)
# category: archilab_Bumblebee.App
# This node will convert an excel address notation from string format (A1) to index format (1,1).

Address = Input(Address: var[]..[])
python_script = Python(IN[0]=Address)
# ---------- python_script.python (31 lines) ----------
# Copyright(c) 2016, David Mans, Konrad Sobon
# @arch_laboratory, http://archi-lab.net, http://neoarchaic.net

import clr
import sys
pyt_path = r'C:\Program Files (x86)\IronPython 2.7\Lib'
sys.path.append(pyt_path)

import System
assemblies = System.AppDomain.CurrentDomain.GetAssemblies()
path1 = [a.Location for a in assemblies if 'bumblebee,' in a.FullName][0]
path2 = System.IO.Path.GetDirectoryName(path1).rsplit('\\',1)[0]
bb_path = '%s\\extra\\' %path2
sys.path.append(bb_path)

import bumblebee as bb
import string
import re

#The inputs to this node will be stored as a list in the IN variable.
dataEnteringNode = IN

cellAddress = IN[0]

def ProcessList(_func, _list):
    return map( lambda x: ProcessList(_func, x) if type(x)==list else _func(x), _list )

if isinstance(cellAddress, list):
	OUT = ProcessList(bb.CellIndex, cellAddress)
else:
	OUT = bb.CellIndex(cellAddress)
# ----------------------------------------
OUT = Output(python_script)
