# Dynamo custom node Cell Value Format Condition.dyf (Dynamo 2.0.1.5055)
# category: archilab_Bumblebee.Format
# This node creates a format condition based on a cell value.

OperatorType = Input(OperatorType: var[]..[])
Values = Input(Values: var[]..[])
GraphicStyle = Input(GraphicStyle: var[]..[])
python_script = Python(IN[0]=OperatorType, IN[1]=Values, IN[2]=GraphicStyle)
# ---------- python_script.python (35 lines) ----------
# Copyright(c) 2016, David Mans, Konrad Sobon
# @arch_laboratory, http://archi-lab.net, http://neoarchaic.net

import clr
import sys

pyt_path = r'C:\Program Files (x86)\IronPython 2.7\Lib'
sys.path.append(pyt_path)

import System
assemblies = System.AppDomain.CurrentDomain.GetAssemblies()
path1 = [a.Location for a in assemblies if 'bumblebee,' in a.FullName][0]
path2 = System.IO.Path.GetDirectoryName(path1).rsplit('\\',1)[0]
bb_path = '%s\\extra\\' %path2
sys.path.append(bb_path)
import bumblebee as bb

#The inputs to this node will be stored as a list in the IN variable.
dataEnteringNode = IN

operatorType = IN[0]
values = IN[1]
graphicStyle = IN[2]

formatCondition = bb.BBCellValueFormatCondition()

if operatorType != None:
	formatCondition.operatorType = operatorType
if values != None:
	formatCondition.values = values
if graphicStyle != None:
	formatCondition.graphicStyle = graphicStyle

#Assign your output to the OUT variable
OUT = formatCondition
# ----------------------------------------
FormatCondition = Output(python_script)
