# Dynamo custom node Chart Style.dyf (Dynamo 2.0.1.5055)
# category: archilab_Bumblebee.Styles
# This node will generate a style that can be used to format a chart.

FillStyle = Input(FillStyle: var = null)
textStyle = Input(textStyle: var = null)
BorderStyle = Input(BorderStyle: var = null)
RoundedCorners = Input(RoundedCorners: bool = false)
python_script = Python(IN[0]=FillStyle, IN[1]=textStyle, IN[2]=BorderStyle, IN[3]=RoundedCorners)
# ---------- python_script.python (37 lines) ----------
# Copyright(c) 2016, David Mans, Konrad Sobon
# @arch_laboratory, http://archi-lab.net, http://neoarchaic.net

import clr
import sys

pyt_path = r'C:\Program Files (x86)\IronPython 2.7\Lib'
sys.path.append(pyt_path)

import System
assemblies = System.AppDomain.CurrentDomain.GetAssemblies()
path1 = [a.Location for a in assemblies if 'bumblebee,' in a.FullName][0]
path2 = System.IO.Path.GetDirectoryName(path1).rsplit('\\',1)[0]
bb_path = '%s\\extra\\' %path2
sys.path.append(bb_path)
import bumblebee as bb

#The inputs to this node will be stored as a list in the IN variable.
dataEnteringNode = IN

fillStyle = IN[0]
textStyle = IN[1]
borderStyle = IN[2]
roundCorners = IN[3]

chartStyle = bb.BBChartStyle()

if fillStyle != None:
	chartStyle.fillStyle = fillStyle
if textStyle != None:
	chartStyle.textStyle = textStyle
if borderStyle != None:
	chartStyle.borderStyle = borderStyle
if roundCorners != None:
	chartStyle.roundCorners = roundCorners
	
OUT = chartStyle
# ----------------------------------------
OUT = Output(python_script)
