# Dynamo custom node Data Bar Format Condition.dyf (Dynamo 2.0.1.5055)
# category: archilab_Bumblebee.Format
# This node will generate a Data Bar format condition. Based on range of numbers a small bar will be placed in a cell that graphically represents the value contained within the cell.

MinType = Input(MinType: var[]..[])
MinValue = Input(MinValue: var = null)
MaxType = Input(MaxType: var[]..[])
MaxValue = Input(MaxValue: var = null)
DirectionType = Input(DirectionType: var = null)
GradientFill = Input(GradientFill: bool = false)
FillColor = Input(FillColor: var = null)
BorderColor = Input(BorderColor: var = null)
python_script = Python(IN[0]=MinType, IN[1]=MinValue, IN[2]=MaxType, IN[3]=MaxValue, IN[4]=DirectionType, IN[5]=GradientFill, IN[6]=FillColor, IN[7]=BorderColor)
# ---------- python_script.python (50 lines) ----------
# Copyright(c) 2016, David Mans, Konrad Sobon
# @arch_laboratory, http://archi-lab.net, http://neoarchaic.net

import clr
import sys

pyt_path = r'C:\Program Files (x86)\IronPython 2.7\Lib'
sys.path.append(pyt_path)

import System
assemblies = System.AppDomain.CurrentDomain.GetAssemblies()
path1 = [a.Location for a in assemblies if 'bumblebee,' in a.FullName][0]
path2 = System.IO.Path.GetDirectoryName(path1).rsplit('\\',1)[0]
bb_path = '%s\\extra\\' %path2
sys.path.append(bb_path)
import bumblebee as bb

#The inputs to this node will be stored as a list in the IN variable.
dataEnteringNode = IN

minType = IN[0]
minValue = IN[1]
maxType = IN[2]
maxValue = IN[3]
directionType = IN[4]
gradientFill = IN[5]
fillColor = IN[6]
borderColor = IN[7]

formatCondition = bb.BBDataBarFormatCondition()

if minType != None:
	formatCondition.minType = minType
if minValue != None:
	formatCondition.minValue = minValue
if maxType != None:
	formatCondition.maxType = maxType
if maxValue != None:
	formatCondition.maxValue = maxValue
if directionType != None:
	formatCondition.directionType = directionType
if gradientFill != None:
	formatCondition.gradientFill = gradientFill
if fillColor != None:
	formatCondition.fillColor = fillColor
if borderColor != None:
	formatCondition.borderColor = borderColor

#Assign your output to the OUT variable
OUT = formatCondition
# ----------------------------------------
FormatCondition = Output(python_script)
