# Dynamo custom node Embed Image.dyf (Dynamo 2.0.1.5055)
# category: archilab_Bumblebee.Write
# This node will embed an image into an Excel document.

filePath = Input(filePath: string = null)  # FilePath to Excel file on drive. Leave empty to access Excel in "live mode".
RunIt = Input(RunIt: bool = false)  # Set to "true" to execute this node.
BBData = Input(BBData: var[]..[])  # BBData node must have a list of FilePaths as input to Data. BBData node must have a list of Origin cells as input to Origin.
imageStyle = Input(imageStyle: var[]..[])  # ImageStyle for the embedded images. ImageStyle node must have matching list for Name input (Origin, Data).
python_script = Python(IN[0]=filePath, IN[1]=RunIt, IN[2]=BBData, IN[3]=imageStyle)
# ---------- python_script.python (150 lines) ----------
# Copyright(c) 2016, David Mans, Konrad Sobon
# @arch_laboratory, http://archi-lab.net, http://neoarchaic.net

import clr
import sys
import System
from System import Array
from System.Collections.Generic import *

clr.AddReferenceByName('Microsoft.Office.Interop.Excel, Version=11.0.0.0, Culture=neutral, PublicKeyToken=71e9bce111e9429c')
from Microsoft.Office.Interop import Excel
System.Threading.Thread.CurrentThread.CurrentCulture = System.Globalization.CultureInfo("en-US")
from System.Runtime.InteropServices import Marshal

pyt_path = r'C:\Program Files (x86)\IronPython 2.7\Lib'
sys.path.append(pyt_path)
from os import path

assemblies = System.AppDomain.CurrentDomain.GetAssemblies()
path1 = [a.Location for a in assemblies if 'bumblebee,' in a.FullName][0]
path2 = System.IO.Path.GetDirectoryName(path1).rsplit('\\',1)[0]
bb_path = '%s\\extra\\' %path2
sys.path.append(bb_path)
import bumblebee as bb

#The inputs to this node will be stored as a list in the IN variable.
dataEnteringNode = IN

filePath = IN[0]
runMe = IN[1]
data = IN[2]
styles = IN[3]

if filePath != None:
	if filePath.GetType() == System.IO.FileInfo:
		filePath = filePath.FullName

def ProcessParallelLists(_func, *lists):
	return map( lambda *xs: ProcessParallelLists(_func, *xs) if all(type(x) is list for x in xs) else _func(*xs), *lists )

def EmbedImage(ws, data, style):
	def EmbedImage2(origin, path, name, ws = ws, width = style.width, height = style.height, link = styles.linkToFile, embed = styles.saveWithDoc):
		img = None
		try:
			img = ws.Shapes(name)
		except:
			pass
		if img == None:
			img = ws.Shapes.AddPicture(path, link, embed, 100, 100, width, height)
			img.Name = name
			img.Left = ws.Cells[bb.CellIndex(origin)[1], bb.CellIndex(origin)[0]].Left
			img.Top = ws.Cells[bb.CellIndex(origin)[1], bb.CellIndex(origin)[0]].Top
			img.Placement = 1
		else:
			img.Left = ws.Cells[bb.CellIndex(origin)[1], bb.CellIndex(origin)[0]].Left
			img.Top = ws.Cells[bb.CellIndex(origin)[1], bb.CellIndex(origin)[0]].Top
			img.Placement = 1
		
		return ws
	if isinstance(data.data, list):
		ProcessParallelLists(EmbedImage2, data.origin, data.data, style.name)
	else:
		EmbedImage2(data.origin, data.data, style.name)

def SetUp(xlApp):
	# supress updates and warning pop ups
	xlApp.Visible = False
	xlApp.DisplayAlerts = False
	xlApp.ScreenUpdating = False
	return xlApp

def ExitExcel(filePath, xlApp, wb, ws):
	def CleanUp(_list):
		if isinstance(_list, list):
			for i in _list:
				Marshal.ReleaseComObject(i)
		else:
			Marshal.ReleaseComObject(_list)
		return None
	
	wb.SaveAs(unicode(filePath))
	xlApp.ActiveWorkbook.Close(False)
	xlApp.ScreenUpdating = True
	CleanUp([ws,wb,xlApp])
	return None

def LiveStream():
	try:
		xlApp = Marshal.GetActiveObject("Excel.Application")
		xlApp.Visible = True
		xlApp.DisplayAlerts = False
		return xlApp
	except:
		return None

if runMe:
	try:
		errorReport = None
		if filePath == None:
			# run excel in a live mode
			xlApp = LiveStream()
			# if excel is running and data is being written to single sheet
			if not isinstance(data, list):
				wb = xlApp.ActiveWorkbook
				try:
					if data.sheetName == None:
						ws = xlApp.ActiveSheet
					else:
						ws = xlApp.Sheets(data.sheetName)
				except:
					pass
				EmbedImage(ws, data, styles)
			# if excel is running and data is being written to multiple sheets
			else:
				wb = xlApp.ActiveWorkbook
				for i in data:
					ws = xlApp.Sheets(i.SheetName())
					EmbedImage(ws , i, styles)
		else:
			try:
				xlApp = SetUp(Excel.ApplicationClass())
				# if excel is closed and data is being written to single sheet
				if not isinstance(data, list):
					xlApp.Workbooks.open(unicode(filePath))
					wb = xlApp.ActiveWorkbook
					ws = xlApp.Sheets(styles.SheetName())
					EmbedImage(ws, data, styles)
					ExitExcel(filePath, xlApp, wb, ws)
				# if excel is closed and data is being written to multiple sheets
				else:
					xlApp.Workbooks.open(unicode(filePath))
					wb = xlApp.ActiveWorkbook
					for i in data:
						ws = xlApp.Sheets(i.SheetName())
						EmbedImage(ws , i, styles)
					ExitExcel(filePath, xlApp, wb, ws)
			except:
				xlApp.Quit()
				Marshal.ReleaseComObject(xlApp)
	except:
			# if error accurs anywhere in the process catch it
			import traceback
			errorReport = traceback.format_exc()
else:
	errorReport = "Run Me is set to False. Please set \nto True if you wish to write data \nto Excel."

if errorReport == None:
	OUT = "Success!"
else:
	OUT = errorReport
# ----------------------------------------
OUT = Output(python_script)
