# Dynamo custom node Fill Style.dyf (Dynamo 2.0.1.5055)
# category: archilab_Bumblebee.Styles
# This node generates a Fill Style that can be used for conditional formatting or regular cell formatting.

PatternType = Input(PatternType: var = null)
BackgroundColor = Input(BackgroundColor: var = null)
PatternColor = Input(PatternColor: var = null)
python_script = Python(IN[0]=PatternType, IN[1]=BackgroundColor, IN[2]=PatternColor)
# ---------- python_script.python (35 lines) ----------
# Copyright(c) 2016, David Mans, Konrad Sobon
# @arch_laboratory, http://archi-lab.net, http://neoarchaic.net

import clr
import sys

pyt_path = r'C:\Program Files (x86)\IronPython 2.7\Lib'
sys.path.append(pyt_path)

import System
assemblies = System.AppDomain.CurrentDomain.GetAssemblies()
path1 = [a.Location for a in assemblies if 'bumblebee,' in a.FullName][0]
path2 = System.IO.Path.GetDirectoryName(path1).rsplit('\\',1)[0]
bb_path = '%s\\extra\\' %path2
sys.path.append(bb_path)
import bumblebee as bb

#The inputs to this node will be stored as a list in the IN variable.
dataEnteringNode = IN

patternType = IN[0]
backgroundColor = IN[1]
patternColor = IN[2]

fillStyle = bb.BBFillStyle()

if patternType != None:
	fillStyle.patternType = patternType
if backgroundColor != None:
	fillStyle.backgroundColor = backgroundColor
if patternColor != None:
	fillStyle.patternColor = patternColor

#Assign your output to the OUT variable
OUT = fillStyle
# ----------------------------------------
FillStyle = Output(python_script)
