# Dynamo custom node Graphic Style.dyf (Dynamo 2.0.1.5055)
# category: archilab_Bumblebee.Styles
# This node will create a graphic style that can be used either for conditional formatting or regular cell formatting.

FillStyle = Input(FillStyle: var = null)
textStyle = Input(textStyle: var = null)
BorderStyle = Input(BorderStyle: var = null)
python_script = Python(IN[0]=FillStyle, IN[1]=textStyle, IN[2]=BorderStyle)
# ---------- python_script.python (34 lines) ----------
# Copyright(c) 2016, David Mans, Konrad Sobon
# @arch_laboratory, http://archi-lab.net, http://neoarchaic.net

import clr
import sys

pyt_path = r'C:\Program Files (x86)\IronPython 2.7\Lib'
sys.path.append(pyt_path)

import System
assemblies = System.AppDomain.CurrentDomain.GetAssemblies()
path1 = [a.Location for a in assemblies if 'bumblebee,' in a.FullName][0]
path2 = System.IO.Path.GetDirectoryName(path1).rsplit('\\',1)[0]
bb_path = '%s\\extra\\' %path2
sys.path.append(bb_path)
import bumblebee as bb

#The inputs to this node will be stored as a list in the IN variable.
dataEnteringNode = IN

fillStyle = IN[0]
textStyle = IN[1]
borderStyle = IN[2]

graphicStyle = bb.BBGraphicStyle()

if fillStyle != None:
	graphicStyle.fillStyle = fillStyle
if textStyle != None:
	graphicStyle.textStyle = textStyle
if borderStyle != None:
	graphicStyle.borderStyle = borderStyle
	
OUT = graphicStyle
# ----------------------------------------
GraphicStyle = Output(python_script)
