# Dynamo custom node Image Style.dyf (Dynamo 2.0.1.5055)
# category: archilab_Bumblebee.Styles
# This node generates an image style for images being embedded in a document.

imageName = Input(imageName: var[]..[])  # Name of the Image object that is being embedded. This list has to match list of images. Names have to be unique.
width = Input(width: int = 150)  # Width of the image in points.
height = Input(height: int = 75)  # Height of the image in points.
linkToFile = Input(linkToFile: bool = false)  # Set to "true" for image to retain link to file on drive.
saveWithDoc = Input(saveWithDoc: bool = true)  # Set to "true" for image to be embedded into the Excel file and be saved with it.
python_script = Python(IN[0]=imageName, IN[1]=width, IN[2]=height, IN[3]=linkToFile, IN[4]=saveWithDoc)
# ---------- python_script.python (40 lines) ----------
# Copyright(c) 2016, David Mans, Konrad Sobon
# @arch_laboratory, http://archi-lab.net, http://neoarchaic.net

import clr
import sys

pyt_path = r'C:\Program Files (x86)\IronPython 2.7\Lib'
sys.path.append(pyt_path)

import System
assemblies = System.AppDomain.CurrentDomain.GetAssemblies()
path1 = [a.Location for a in assemblies if 'bumblebee,' in a.FullName][0]
path2 = System.IO.Path.GetDirectoryName(path1).rsplit('\\',1)[0]
bb_path = '%s\\extra\\' %path2
sys.path.append(bb_path)
import bumblebee as bb

#The inputs to this node will be stored as a list in the IN variable.
dataEnteringNode = IN

name = IN[0]
width = IN[1]
height = IN[2]
linkToFile = IN[3]
saveWithDoc = IN[4]

imageStyle = bb.BBImageStyle()

if name != None:
	imageStyle.name = name
if width != None:
	imageStyle.width = width
if height != None:
	imageStyle.height = height
if linkToFile != None:
	imageStyle.linkToFile = linkToFile
if saveWithDoc != None:
	imageStyle.saveWithDoc = saveWithDoc
	
OUT = imageStyle
# ----------------------------------------
imageStyle = Output(python_script)
