# Dynamo custom node Label Style.dyf (Dynamo 2.0.1.5055)
# category: archilab_Bumblebee.Styles
# This node will generate a style that can be used to format labels on a chart.

FillStyle = Input(FillStyle: var = null)
textStyle = Input(textStyle: var = null)
BorderStyle = Input(BorderStyle: var = null)
ShowSeriesName = Input(ShowSeriesName: bool = false)
ShowValue = Input(ShowValue: bool = false)
ShowPercentage = Input(ShowPercentage: bool = false)
ShowLeaderLines = Input(ShowLeaderLines: bool = false)
ShowLegendKey = Input(ShowLegendKey: bool = false)
Separator = Input(Separator: var = null)
LabelPosition = Input(LabelPosition: var = null)
python_script = Python(IN[0]=FillStyle, IN[1]=textStyle, IN[2]=BorderStyle, IN[3]=ShowSeriesName, IN[4]=ShowValue, IN[5]=ShowPercentage, IN[6]=ShowLeaderLines, IN[7]=ShowLegendKey, IN[8]=Separator, IN[9]=LabelPosition)
# ---------- python_script.python (56 lines) ----------
# Copyright(c) 2016, David Mans, Konrad Sobon
# @arch_laboratory, http://archi-lab.net, http://neoarchaic.net

import clr
import sys

pyt_path = r'C:\Program Files (x86)\IronPython 2.7\Lib'
sys.path.append(pyt_path)

import System
assemblies = System.AppDomain.CurrentDomain.GetAssemblies()
path1 = [a.Location for a in assemblies if 'bumblebee,' in a.FullName][0]
path2 = System.IO.Path.GetDirectoryName(path1).rsplit('\\',1)[0]
bb_path = '%s\\extra\\' %path2
sys.path.append(bb_path)
import bumblebee as bb

#The inputs to this node will be stored as a list in the IN variable.
dataEnteringNode = IN

fillStyle = IN[0]
textStyle = IN[1]
borderStyle = IN[2]
seriesName = IN[3]
value = IN[4]
percentage = IN[5]
leaderLines = IN[6]
legendKey = IN[7]
separator = IN[8]
labelPosition = IN[9]

labelStyle = bb.BBLabelStyle()

if fillStyle != None:
	labelStyle.fillStyle = fillStyle
if textStyle != None:
	labelStyle.textStyle = textStyle
if borderStyle != None:
	labelStyle.borderStyle = borderStyle
if seriesName != None:
	labelStyle.seriesName = seriesName
if value != None:
	labelStyle.value = value
if percentage != None:
	labelStyle.percentage = percentage
if leaderLines != None:
	labelStyle.leaderLines = leaderLines
if legendKey != None:
	labelStyle.legendKey = legendKey
if separator != None:
	labelStyle.separator = separator
if labelPosition != None:
	labelStyle.labelPosition = labelPosition

#Assign your output to the OUT variable
OUT = labelStyle
# ----------------------------------------
OUT = Output(python_script)
