# Dynamo custom node Legend Style.dyf (Dynamo 2.0.1.5055)
# category: archilab_Bumblebee.Styles
# This node will generate a style to visually format a chart legend.

FillStyle = Input(FillStyle: var = null)
textStyle = Input(textStyle: var = null)
BorderStyle = Input(BorderStyle: var = null)
LegendPositionType = Input(LegendPositionType: var = null)
LegendLabels = Input(LegendLabels: var = null)
python_script = Python(IN[0]=FillStyle, IN[1]=textStyle, IN[2]=BorderStyle, IN[3]=LegendPositionType, IN[4]=LegendLabels)
# ---------- python_script.python (40 lines) ----------
# Copyright(c) 2016, David Mans, Konrad Sobon
# @arch_laboratory, http://archi-lab.net, http://neoarchaic.net

import clr
import sys

pyt_path = r'C:\Program Files (x86)\IronPython 2.7\Lib'
sys.path.append(pyt_path)

import System
assemblies = System.AppDomain.CurrentDomain.GetAssemblies()
path1 = [a.Location for a in assemblies if 'bumblebee,' in a.FullName][0]
path2 = System.IO.Path.GetDirectoryName(path1).rsplit('\\',1)[0]
bb_path = '%s\\extra\\' %path2
sys.path.append(bb_path)
import bumblebee as bb

#The inputs to this node will be stored as a list in the IN variable.
dataEnteringNode = IN

fillStyle = IN[0]
textStyle = IN[1]
borderStyle = IN[2]
position = IN[3]
labels = IN[4]

legendStyle = bb.BBLegendStyle()

if fillStyle != None:
	legendStyle.fillStyle = fillStyle
if textStyle != None:
	legendStyle.textStyle = textStyle
if borderStyle != None:
	legendStyle.borderStyle = borderStyle
if position != None:
	legendStyle.position = position
if labels != None:
	legendStyle.labels = labels
	
OUT = legendStyle
# ----------------------------------------
OUT = Output(python_script)
