# Dynamo custom node Line Chart Graph Style.dyf (Dynamo 2.0.1.5055)
# category: archilab_Bumblebee.Styles
# This node controls appearance of the graph area of the chart. In this case it will be the line portion of the Line Chart.

LabelStyle = Input(LabelStyle: var = null)
LineStyle = Input(LineStyle: var = null)
MarkerStyle = Input(MarkerStyle: var = null)
python_script = Python(IN[0]=LabelStyle, IN[1]=LineStyle, IN[2]=MarkerStyle)
# ---------- python_script.python (34 lines) ----------
# Copyright(c) 2016, David Mans, Konrad Sobon
# @arch_laboratory, http://archi-lab.net, http://neoarchaic.net

import clr
import sys

pyt_path = r'C:\Program Files (x86)\IronPython 2.7\Lib'
sys.path.append(pyt_path)

import System
assemblies = System.AppDomain.CurrentDomain.GetAssemblies()
path1 = [a.Location for a in assemblies if 'bumblebee,' in a.FullName][0]
path2 = System.IO.Path.GetDirectoryName(path1).rsplit('\\',1)[0]
bb_path = '%s\\extra\\' %path2
sys.path.append(bb_path)
import bumblebee as bb

#The inputs to this node will be stored as a list in the IN variable.
dataEnteringNode = IN

labelStyle = IN[0]
lineStyle = IN[1]
markerStyle = IN[2]

lineGraphStyle = bb.BBLineGraphStyle()

if labelStyle != None:
	lineGraphStyle.labelStyle = labelStyle
if lineStyle != None:
	lineGraphStyle.lineStyle = lineStyle
if markerStyle != None:
	lineGraphStyle.markerStyle = markerStyle
	
OUT = lineGraphStyle
# ----------------------------------------
GraphStyle = Output(python_script)
