# Dynamo custom node Line Style.dyf (Dynamo 2.0.1.5055)
# category: archilab_Bumblebee.Styles
# This node controls Chart's Line Style ex. Line Chart.

LineColor = Input(LineColor: var = null)
Weight = Input(Weight: var = null)
MsoLineType = Input(MsoLineType: var = null)
CompoundLineType = Input(CompoundLineType: var = null)
Smooth = Input(Smooth: bool = false)
python_script = Python(IN[0]=LineColor, IN[1]=Weight, IN[2]=MsoLineType, IN[3]=CompoundLineType, IN[4]=Smooth)
# ---------- python_script.python (41 lines) ----------
# Copyright(c) 2016, David Mans, Konrad Sobon
# @arch_laboratory, http://archi-lab.net, http://neoarchaic.net

import clr
import sys

pyt_path = r'C:\Program Files (x86)\IronPython 2.7\Lib'
sys.path.append(pyt_path)

import System
assemblies = System.AppDomain.CurrentDomain.GetAssemblies()
path1 = [a.Location for a in assemblies if 'bumblebee,' in a.FullName][0]
path2 = System.IO.Path.GetDirectoryName(path1).rsplit('\\',1)[0]
bb_path = '%s\\extra\\' %path2
sys.path.append(bb_path)
import bumblebee as bb

#The inputs to this node will be stored as a list in the IN variable.
dataEnteringNode = IN

color = IN[0]
weight = IN[1]
lineType = IN[2]
compoundLineType = IN[3]
smooth = IN[4]

lineStyle = bb.BBLineStyle()

if color != None:
	lineStyle.color = color
if weight != None:
	lineStyle.weight = weight
if lineType != None:
	lineStyle.lineType = lineType
if compoundLineType != None:
	lineStyle.compoundLineType = compoundLineType
if smooth != None:
	lineStyle.smooth = smooth

#Assign your output to the OUT variable
OUT = lineStyle
# ----------------------------------------
LineStyle = Output(python_script)
