# Dynamo custom node Marker Style.dyf (Dynamo 2.0.1.5055)
# category: archilab_Bumblebee.Styles
# This node controls the Marker Style that can be used with charts ex. Line Chart.

MarkerType = Input(MarkerType: var = null)
MarkerSize = Input(MarkerSize: var = null)
BackgroundColor = Input(BackgroundColor: var = null)
ForegroundColor = Input(ForegroundColor: var = null)
python_script = Python(IN[0]=MarkerType, IN[1]=MarkerSize, IN[2]=BackgroundColor, IN[3]=ForegroundColor)
# ---------- python_script.python (38 lines) ----------
# Copyright(c) 2016, David Mans, Konrad Sobon
# @arch_laboratory, http://archi-lab.net, http://neoarchaic.net

import clr
import sys

pyt_path = r'C:\Program Files (x86)\IronPython 2.7\Lib'
sys.path.append(pyt_path)

import System
assemblies = System.AppDomain.CurrentDomain.GetAssemblies()
path1 = [a.Location for a in assemblies if 'bumblebee,' in a.FullName][0]
path2 = System.IO.Path.GetDirectoryName(path1).rsplit('\\',1)[0]
bb_path = '%s\\extra\\' %path2
sys.path.append(bb_path)
import bumblebee as bb

#The inputs to this node will be stored as a list in the IN variable.
dataEnteringNode = IN

markerType = IN[0]
markerSize = IN[1]
markerColor = IN[2]
markerBorderColor = IN[3]

markerStyle = bb.BBMarkerStyle()

if markerType != None:
	markerStyle.markerType = markerType
if markerSize != None:
	markerStyle.markerSize = markerSize
if markerColor != None:
	markerStyle.markerColor = markerColor
if markerBorderColor != None:
	markerStyle.markerBorderColor = markerBorderColor

#Assign your output to the OUT variable
OUT = markerStyle
# ----------------------------------------
MarkerStyle = Output(python_script)
