# Dynamo custom node New File By Template.dyf (Dynamo 2.0.1.5055)
# category: archilab_Bumblebee.App
# This node will take a template file and create a new file based on that template.

templateFilePath = Input(templateFilePath: var[]..[])
newFileDirectory = Input(newFileDirectory: var[]..[])
newFileName = Input(newFileName: var[]..[])
Data = Input(Data: var[]..[])
dataSheetName = Input(dataSheetName: var[]..[])
templateSheetName = Input(templateSheetName: var[]..[])
RunIt = Input(RunIt: bool = false)
python_script = Python(IN[0]=templateFilePath, IN[1]=newFileDirectory, IN[2]=newFileName, IN[3]=Data, IN[4]=dataSheetName, IN[5]=templateSheetName, IN[6]=RunIt)
# ---------- python_script.python (83 lines) ----------
# Copyright(c) 2016, David Mans, Konrad Sobon
# @arch_laboratory, http://archi-lab.net, http://neoarchaic.net

import clr
import sys
import System
from System import Array
from System.Collections.Generic import *

clr.AddReferenceByName('Microsoft.Office.Interop.Excel, Version=11.0.0.0, Culture=neutral, PublicKeyToken=71e9bce111e9429c')
from Microsoft.Office.Interop import Excel
System.Threading.Thread.CurrentThread.CurrentCulture = System.Globalization.CultureInfo("en-US")
from System.Runtime.InteropServices import Marshal

pyt_path = r'C:\Program Files (x86)\IronPython 2.7\Lib'
sys.path.append(pyt_path)

assemblies = System.AppDomain.CurrentDomain.GetAssemblies()
path1 = [a.Location for a in assemblies if 'bumblebee,' in a.FullName][0]
path2 = System.IO.Path.GetDirectoryName(path1).rsplit('\\',1)[0]
bb_path = '%s\\extra\\' %path2
sys.path.append(bb_path)
import bumblebee as bb

#The inputs to this node will be stored as a list in the IN variable.
dataEnteringNode = IN

tempFilePath = IN[0]
newFilePath = IN[1]
newFileName = IN[2]
data = IN[3]
sheetName = IN[4]
tempSheetName = IN[5]
RunIt = IN[6]

def SetUp(xlApp):
	# supress updates and warning pop ups
	xlApp.Visible = False
	xlApp.DisplayAlerts = False
	xlApp.ScreenUpdating = False
	return xlApp

if RunIt:
	message = None
	try:
		errorReport = None
		message = "Success!"
		
		xlApp = Excel.ApplicationClass() 
		SetUp(xlApp)
		for i in range(0, len(data), 1):
			xlApp.Workbooks.Open(unicode(tempFilePath))
			wb = xlApp.ActiveWorkbook
			ws = xlApp.Sheets(sheetName)
			
			rng = ws.Range(ws.Cells(1, 1), ws.Cells(len(data[i]), 1))
			rng.Value = xlApp.Transpose(Array[str](data[i]))
		
			ws = xlApp.Sheets(tempSheetName)
			ws.Activate
	        
			xlApp.ActiveWorkbook.SaveAs(newFilePath + "\\" + str(newFileName[i]) + ".xlsx")
			xlApp.ActiveWorkbook.Close(False)
			xlApp.screenUpdating = True
			Marshal.ReleaseComObject(ws)
			Marshal.ReleaseComObject(wb)
		xlApp.Quit()
		Marshal.ReleaseComObject(xlApp)
	except:
		xlApp.Quit()
		Marshal.ReleaseComObject(xlApp)
		# if error accurs anywhere in the process catch it
		import traceback
		errorReport = traceback.format_exc()
		pass
else:
	errorReport = None
	message = "Run Me is set to False."

if errorReport == None:
	OUT = OUT = '\n'.join('{:^35}'.format(s) for s in message.split('\n'))
else:
	OUT = errorReport
# ----------------------------------------
OUT = Output(python_script)
