# Dynamo custom node Pie Chart.dyf (Dynamo 2.0.1.5055)
# category: archilab_Bumblebee.Charts
# This node will generate a new Pie Chart in your currently running session of Excel.

RunIt = Input(RunIt: bool = false)
SheetName = Input(SheetName: var[]..[])
SizeRange = Input(SizeRange: var[]..[])
Title = Input(Title: var = null)
DataRange = Input(DataRange: var[]..[])
PieChartType = Input(PieChartType: var[]..[])
LegendStyle = Input(LegendStyle: var = null)
ChartStyle = Input(ChartStyle: var = null)
GraphStyle = Input(GraphStyle: var = null)
python_script = Python(IN[0]=RunIt, IN[1]=SheetName, IN[2]=SizeRange, IN[3]=Title, IN[4]=DataRange, IN[5]=PieChartType, IN[6]=LegendStyle, IN[7]=ChartStyle, IN[8]=GraphStyle)
# ---------- python_script.python (259 lines) ----------
# Copyright(c) 2016, David Mans, Konrad Sobon
# @arch_laboratory, http://archi-lab.net, http://neoarchaic.net

import clr
import sys
import System
from System import Array
from System.Collections.Generic import *

clr.AddReferenceByName('Microsoft.Office.Interop.Excel, Version=11.0.0.0, Culture=neutral, PublicKeyToken=71e9bce111e9429c')
from Microsoft.Office.Interop import Excel
System.Threading.Thread.CurrentThread.CurrentCulture = System.Globalization.CultureInfo("en-US")
from System.Runtime.InteropServices import Marshal

pyt_path = r'C:\Program Files (x86)\IronPython 2.7\Lib'
sys.path.append(pyt_path)

import System
assemblies = System.AppDomain.CurrentDomain.GetAssemblies()
path1 = [a.Location for a in assemblies if 'bumblebee,' in a.FullName][0]
path2 = System.IO.Path.GetDirectoryName(path1).rsplit('\\',1)[0]
bb_path = '%s\\extra\\' %path2
sys.path.append(bb_path)

import bumblebee as bb
import string
import re

#The inputs to this node will be stored as a list in the IN variable.
dataEnteringNode = IN

runMe = IN[0]
sheetName = IN[1]
size = IN[2]
title = IN[3]
dataRange = IN[4]
chartType = IN[5]
legendStyle = IN[6]
chartStyle = IN[7]
graphStyle = IN[8]

def LiveStream():
	try:
		xlApp = Marshal.GetActiveObject("Excel.Application")
		xlApp.Visible = True
		xlApp.DisplayAlerts = False
		xlApp.ScreenUpdating = False
		return xlApp
	except:
		return None

def GetWidthHeight(origin, extent, ws):
	left = origin.Left
	top = origin.Top
	width = ws.Range[origin, extent].Width
	height = ws.Range[origin, extent].Height
	return [left, top, width, height]

def FormatBorder(border, bStyle):
	if bStyle.lineType != None:
		border.LineStyle = bStyle.LineType()
	if bStyle.weight != None:
		border.Weight = bStyle.Weight()
	if bStyle.color != None:
		border.Color = bStyle.Color()
	return None

def FormatText(text, tStyle):
	if tStyle.name != None:
		text.Name = tStyle.Name()
	if tStyle.size != None:
		text.Size = tStyle.Size()
	if tStyle.color != None:
		text.Color = tStyle.Color()
	if tStyle.bold != None:
		text.Bold = tStyle.Bold()
	if tStyle.italic != None:
		text.Italic = tStyle.Italic()
	if tStyle.underline != None:
		text.Underline = tStyle.Underline()
	if tStyle.strikethrough != None:
		text.Strikethrough = tStyle.Strikethrough()
	return None

def FormatFill(fill, fStyle):
	if fStyle.patternType != None:
		fill.Pattern = fStyle.PatternType()	
	if fStyle.patternColor != None:
		fill.PatternColor = fStyle.PatternColor()	
	if fStyle.backgroundColor != None:
		fill.Color = fStyle.BackgroundColor()
	return None

if runMe:
	message = None
	try:
		xlApp = LiveStream()
		errorReport = None
		wb = xlApp.ActiveWorkbook
		ws = xlApp.Sheets(sheetName)
		# get chart size and location from range
		origin = ws.Cells(bb.xlRange(size)[1], bb.xlRange(size)[0])
		extent = ws.Cells(bb.xlRange(size)[3], bb.xlRange(size)[2])
		left = GetWidthHeight(origin, extent, ws)[0]
		top = GetWidthHeight(origin, extent, ws)[1]
		width = GetWidthHeight(origin, extent, ws)[2]
		height = GetWidthHeight(origin, extent, ws)[3]
		# get existing chart with same name or create new
		if ws.ChartObjects().Count > 0:
			for i in range(1, ws.ChartObjects().Count + 1, 1):
				if ws.ChartObjects().Item(i).Name == title:
					chartObject = ws.ChartObjects().Item(i)
		else:
			chartObjects = ws.ChartObjects()
			chartObject = chartObjects.Add(left, top, width, height)
			if title != None:
				chartObject.Name = title
			else:
				chartObject.Name = "Untitled"
		# update chart size
		if chartObject.Left != left:
			chartObject.Left = left
		if chartObject.Top != top:
			chartObject.Top = top
		if chartObject.Width != width:
			chartObject.Width = width
		if chartObject.Height != height:
			chartObject.Height = height
		# get chart object
		xlChart = chartObject.Chart
		# set chart type
		xlChart.ChartType = chartType
		# set chart data source range
		dataOrigin = ws.Cells(bb.xlRange(dataRange)[1], bb.xlRange(dataRange)[0])
		dataExtent = ws.Cells(bb.xlRange(dataRange)[3], bb.xlRange(dataRange)[2])
		xlChart.SetSourceData(ws.Range[dataOrigin, dataExtent])
		# set chart title
		if title != None:
			xlChart.HasTitle = True
			xlChart.ChartTitle.Text = title
		else:
			xlChart.HasTitle = False

		#########################
		### Legend Formatting ###
		#########################

		if xlChart.HasLegend:
			xlChart.Legend.Clear()
		# set text style for legend
		if legendStyle != None:
			xlChart.HasLegend = True
			# set legend box position
			if legendStyle.position != None:
				xlChart.Legend.Position = legendStyle.Position()
			# set legend text style
			if legendStyle.textStyle != None:
				FormatText(xlChart.Legend.Font, legendStyle.textStyle)
			# set border style for legend
			if legendStyle.borderStyle != None:
				FormatBorder(xlChart.Legend.Border, legendStyle.borderStyle)
			#set fill style for legend
			if legendStyle.fillStyle != None:
				FormatFill(xlChart.Legend.Interior, legendStyle.fillStyle)
			# change default Legend labels to range
			if legendStyle.labels != None:
				labels = legendStyle.Labels()
				chartSeries = xlChart.Seriescollection(1)
				catOrigin = ws.Cells(labels[1], labels[0])
				catExtent = ws.Cells(labels[3], labels[2])
				chartSeries.XValues = ws.Range[catOrigin, catExtent]

		########################
		### Chart Formatting ###
		########################

		if chartStyle != None:
			if chartStyle.borderStyle != None:
				xlChart.ChartArea.Format.Line.Visible = True
				FormatBorder(xlChart.ChartArea.Border, chartStyle.borderStyle)
			else:
				xlChart.ChartArea.Format.Line.Visible = False
			if chartStyle.fillStyle != None:
				xlChart.ChartArea.Fill.Visible = True
				xlChart.PlotArea.Fill.Visible = True
				FormatFill(xlChart.ChartArea.Interior, chartStyle.fillStyle)
			else:
				xlChart.ChartArea.Fill.Visible = False
				xlChart.PlotArea.Fill.Visible = False
			if chartStyle.roundCorners != None:
				xlChart.ChartArea.RoundedCorners = chartStyle.RoundCorners()

		########################
		### Graph Formatting ###
		########################

		xlChart.SeriesCollection(1).ClearFormats()
		# set graph style
		if graphStyle != None:
			# set graph fill style
			if graphStyle.fillStyle != None:
				count = xlChart.SeriesCollection(1).Points().Count
				for i in range(1, count + 1, 1):
					FormatFill(xlChart.SeriesCollection(1).Points(i).Interior, graphStyle.fillStyle)
			# set graph border style
			if graphStyle.borderStyle != None:
				count = xlChart.SeriesCollection(1).Points().Count
				for i in range(1, count + 1, 1):
					FormatBorder(xlChart.SeriesCollection(1).Points(i).Border, graphStyle.borderStyle)

			########################
			### Label Formatting ###
			########################

			# set label style
			if graphStyle.labelStyle != None:
				if xlChart.SeriesCollection(1).HasDataLabels == True:
					xlChart.SeriesCollection(1).DataLabels().Delete()
					xlChart.SeriesCollection(1).HasDataLabels = True
				else:
					xlChart.SeriesCollection(1).HasDataLabels = True
				gls = graphStyle.labelStyle
				if gls.percentage != None:
					xlChart.SeriesCollection(1).DataLabels().ShowPercentage = gls.Percentage()
				if gls.seriesName != None:
					xlChart.SeriesCollection(1).DataLabels().ShowSeriesName = gls.SeriesName()
				if gls.value != None:
					xlChart.SeriesCollection(1).DataLabels().ShowValue = gls.Value()
				if gls.legendKey != None:
					xlChart.SeriesCollection(1).DataLabels().ShowLegendKey = gls.LegendKey()
				if gls.separator != None:
					xlChart.SeriesCollection(1).DataLabels().Separator = gls.Separator()
				if gls.labelPosition != None:
					xlChart.SeriesCollection(1).DataLabels().Position = gls.LabelPosition()
				if gls.leaderLines != None:
					xlChart.SeriesCollection(1).HasLeaderLines = gls.LeaderLines()
				# set label fill settings
				if gls.fillStyle != None:
					FormatFill(xlChart.SeriesCollection(1).DataLabels().Interior, gls.fillStyle)
				# set label text style
				if gls.textStyle != None:
					FormatText(xlChart.SeriesCollection(1).DataLabels().Font, gls.textStyle)
				# set label border style
				if gls.borderStyle != None:
					FormatBorder(xlChart.SeriesCollection(1).DataLabels().Border, gls.borderStyle)
			if graphStyle.explosion != None:
				xlChart.SeriesCollection(1).Explosion = graphStyle.Explosion()
		xlApp.ScreenUpdating = True
	except:
		# if error accurs anywhere in the process catch it
		import traceback
		errorReport = traceback.format_exc()
else:
	errorReport = "RunMe is set to False. Please set RunMe to True to create/update chart."

if errorReport == None:
	OUT = "Success!"
else:
	OUT = errorReport
# ----------------------------------------
OUT = Output(python_script)
