# Dynamo custom node Search Value Get Row.dyf (Dynamo 2.0.1.5055)
# category: archilab_Bumblebee.App
# This node will search the Excel Spreadsheet for a single string value and return an entire row of data that this value was found in. For example if key was found at A15 then entire row 15 will be returned.

filePath = Input(filePath: var = null)
RunIt = Input(RunIt: var[]..[])
SheetName = Input(SheetName: var = null)
SearchFor = Input(SearchFor: var[]..[])
python_script = Python(IN[0]=filePath, IN[1]=RunIt, IN[2]=SheetName, IN[3]=SearchFor)
# ---------- python_script.python (144 lines) ----------
# Copyright(c) 2016, David Mans, Konrad Sobon
# @arch_laboratory, http://archi-lab.net, http://neoarchaic.net

import clr
import sys
import System
from System import Array
from System.Collections.Generic import *

clr.AddReferenceByName('Microsoft.Office.Interop.Excel, Version=11.0.0.0, Culture=neutral, PublicKeyToken=71e9bce111e9429c')
from Microsoft.Office.Interop import Excel
System.Threading.Thread.CurrentThread.CurrentCulture = System.Globalization.CultureInfo("en-US")
from System.Runtime.InteropServices import Marshal

pyt_path = r'C:\Program Files (x86)\IronPython 2.7\Lib'
sys.path.append(pyt_path)
from os import path

assemblies = System.AppDomain.CurrentDomain.GetAssemblies()
path1 = [a.Location for a in assemblies if 'bumblebee,' in a.FullName][0]
path2 = System.IO.Path.GetDirectoryName(path1).rsplit('\\',1)[0]
bb_path = '%s\\extra\\' %path2
sys.path.append(bb_path)
import bumblebee as bb

#The inputs to this node will be stored as a list in the IN variable.
dataEnteringNode = IN

filePath = IN[0]
runMe = IN[1]
sheetName = IN[2]
searchValues = IN[3]

if filePath != None:
	if filePath.GetType() == System.IO.FileInfo:
		filePath = filePath.FullName

def SetUp(xlApp):
	# supress updates and warning pop ups
	xlApp.Visible = False
	xlApp.DisplayAlerts = False
	xlApp.ScreenUpdating = False
	return xlApp

def ExitExcel(filePath, xlApp, wb, ws):
	# clean up before exiting excel, if any COM object remains
	# unreleased then excel crashes on open following time
	def CleanUp(_list):
		if isinstance(_list, list):
			for i in _list:
				Marshal.ReleaseComObject(i)
		else:
			Marshal.ReleaseComObject(_list)
		return None
	
	wb.SaveAs(unicode(filePath))
	xlApp.ActiveWorkbook.Close(False)
	xlApp.ScreenUpdating = True
	CleanUp([ws,wb,xlApp])
	return None

def LiveStream():
	try:
		xlApp = Marshal.GetActiveObject("Excel.Application")
		xlApp.Visible = True
		xlApp.DisplayAlerts = False
		return xlApp
	except:
		return None

def SearchValueGetRow(xlApp, ws, key):
	# get spreadhseet extents to limit search context
	originX = ws.UsedRange.Row
	originY = ws.UsedRange.Column
	boundX = ws.UsedRange.Rows(ws.UsedRange.Rows.Count).Row
	boundY = ws.UsedRange.Columns(ws.UsedRange.Columns.Count).Column
	# define search criteria
	xlAfter = ws.Cells(originY, originX)
	xlLookIn = -4163
	xlLookAt = "&H2"
	xlSearchOrder = "&H1"
	xlSearchDirection = 1
	xlMatchCase = False
	xlMatchByte = False
	xlSearchFormat = False
	# get search value and return row 
	# if value not found return None
	cell = ws.Cells.Find(key, xlAfter, xlLookIn, xlLookAt, xlSearchOrder, xlSearchDirection, xlMatchCase, xlMatchByte, xlSearchFormat)
	if cell != None:
		cellAddress = cell.Address(False, False)
		addressX = xlApp.Range(cellAddress).Row
		addressY = xlApp.Range(cellAddress).Column
		row = ws.Range[ws.Cells(addressX, originY), ws.Cells(addressX, boundY)].Value2
		return row
	else:
		return None
try:
	errorReport = None
	if runMe:
		message = None
		dataOut = []
		if filePath == None:
			# run excel in a live mode
			xlApp = LiveStream()
			wb = xlApp.ActiveWorkbook
			if sheetName == None:
				ws = xlApp.ActiveSheet
			else:
				ws = xlApp.Sheets(sheetName)
			if isinstance(searchValues, list):
				for key in searchValues:
					dataOut.append(SearchValueGetRow(xlApp, ws, key))
			else:
				dataOut = SearchValueGetRow(xlApp, ws, key)
		else:
			try:
				# open excel workbook specified at filePath
				xlApp = SetUp(Excel.ApplicationClass())
				if os.path.isfile(unicode(filePath)):
					xlApp.Workbooks.open(unicode(filePath))
					wb = xlApp.ActiveWorkbook
					ws = xlApp.Sheets(sheetName)
					if isinstance(searchValues, list):
						for key in searchValues:
							dataOut.append(SearchValueGetRow(xlApp, ws, key))
					else:
						dataOut = SearchValueGetRow(xlApp, ws, key)
					ExitExcel(filePath, xlApp, wb, ws)
			except:
				xlApp.Quit()
				Marshal.ReleaseComObject(xlApp)
				pass
	else:
		errorReport = "Run Me is set to False. Please set \nto True if you wish to read data \nfrom Excel."
except:
		# if error accurs anywhere in the process catch it
		import traceback
		errorReport = traceback.format_exc()

#Assign your output to the OUT variable
if errorReport == None:
	OUT = dataOut
else:
	OUT = errorReport
# ----------------------------------------
OUT = Output(python_script)
