# Dynamo custom node Text Style.dyf (Dynamo 2.0.1.5055)
# category: archilab_Bumblebee.Styles
# This node will generate a text style that can be used to format excel or with conditional formatting.

Name = Input(Name: string = "Calibri")
Size = Input(Size: string = "11")
FontColor = Input(FontColor: DSCore.Color = null)
HorizontalAlignType = Input(HorizontalAlignType: int = null)
VerticalAlignType = Input(VerticalAlignType: int = null)
Bold = Input(Bold: bool = false)
Italic = Input(Italic: bool = false)
Underline = Input(Underline: bool = false)
Strikethrough = Input(Strikethrough: bool = false)
python_script = Python(IN[0]=Name, IN[1]=Size, IN[2]=FontColor, IN[3]=HorizontalAlignType, IN[4]=VerticalAlignType, IN[5]=Bold, IN[6]=Italic, IN[7]=Underline, IN[8]=Strikethrough)
# ---------- python_script.python (53 lines) ----------
# Copyright(c) 2016, David Mans, Konrad Sobon
# @arch_laboratory, http://archi-lab.net, http://neoarchaic.net

import clr
import sys

pyt_path = r'C:\Program Files (x86)\IronPython 2.7\Lib'
sys.path.append(pyt_path)

import System
assemblies = System.AppDomain.CurrentDomain.GetAssemblies()
path1 = [a.Location for a in assemblies if 'bumblebee,' in a.FullName][0]
path2 = System.IO.Path.GetDirectoryName(path1).rsplit('\\',1)[0]
bb_path = '%s\\extra\\' %path2
sys.path.append(bb_path)
import bumblebee as bb

#The inputs to this node will be stored as a list in the IN variable.
dataEnteringNode = IN

name = IN[0]
size = IN[1]
color = IN[2]
hAlign = IN[3]
vAlign = IN[4]
bold = IN[5]
italic = IN[6]
underline = IN[7]
strikethrough = IN[8]

textStyle = bb.BBTextStyle()

if name != None:
	textStyle.name = name
if size != None:
	textStyle.size = size
if color != None:
	textStyle.color = color
if hAlign != None:
	textStyle.horizontalAlign = hAlign
if vAlign != None:
	textStyle.verticalAlign = vAlign
if bold != None:
	textStyle.bold = bold
if italic != None:
	textStyle.italic = italic
if underline != None:
	textStyle.underline = underline
if strikethrough != None:
	textStyle.strikethrough = strikethrough

#Assign your output to the OUT variable
OUT = textStyle
# ----------------------------------------
OUT = Output(python_script)
