# Dynamo custom node Top Bottom Percentile Format Condition.dyf "Top/Bottom Percentile Format Condition" (Dynamo 2.0.1.5055)
# category: archilab_Bumblebee.Format
# This node will generate a Formatting Condition based on the top/bottom ranked values. It can either be top percentile (0-100) or number of top/bottom ranked values (top 10 values for example).

Percent = Input(Percent: bool = true)
Rank = Input(Rank: var[]..[])
Top = Input(Top: bool = true)
# note: Graphic Style
GraphicStyle = Input(GraphicStyle: var[]..[])
# note: Rank
# note: Percent?
# note: Top?
# note: Top/Bottom Percentile Format Condition
python_script = Python(IN[0]=Percent, IN[1]=Rank, IN[2]=Top, IN[3]=GraphicStyle)
# ---------- python_script.python (39 lines) ----------
# Copyright(c) 2016, David Mans, Konrad Sobon
# @arch_laboratory, http://archi-lab.net, http://neoarchaic.net

import clr
import sys

pyt_path = r'C:\Program Files (x86)\IronPython 2.7\Lib'
sys.path.append(pyt_path)

import System
assemblies = System.AppDomain.CurrentDomain.GetAssemblies()
path1 = [a.Location for a in assemblies if 'bumblebee,' in a.FullName][0]
path2 = System.IO.Path.GetDirectoryName(path1).rsplit('\\',1)[0]
bb_path = '%s\\extra\\' %path2
sys.path.append(bb_path)
import bumblebee as bb

#The inputs to this node will be stored as a list in the IN variable.
dataEnteringNode = IN

percent = IN[0]
rank = IN[1]
topBottom = IN[2]
graphicStyle = IN[3]

formatCondition = bb.BBTopPercentileFormatCondition()

if percent != None:
	formatCondition.percent = percent
if rank != None:
	formatCondition.rank = rank
if topBottom != None:
	formatCondition.topBottom = topBottom
if graphicStyle != None:
	formatCondition.graphicStyle = graphicStyle


#Assign your output to the OUT variable
OUT = formatCondition
# ----------------------------------------
FormatCondition = Output(python_script)
